# Grasshopper definition Structural_mapper.gh (Grasshopper 1.0.7)
# plug-ins: Karamba3D

# ---- group: Generate random set
number_slider = Slider(108, range=0..1000)
dom = ConstructDomain(DomainStart=Slider(20, range=0..1000), DomainEnd=Slider(500, range=0..1000))
dom_2 = ConstructDomain(DomainStart=Slider(500, range=0..15000), DomainEnd=Slider(8220, range=0..15000))
random = Random(Range=dom, Number=number_slider, Seed=3)
random_2 = Random(Range=dom_2, Number=number_slider, Seed=5)
random_3 = Random(Range=dom, Number=number_slider, Seed=2)
pt = ConstructPoint(XCoordinate=0, YCoordinate=0, ZCoordinate=0)
pt_2 = ConstructPoint(XCoordinate=random_3, YCoordinate=random, ZCoordinate=0)
rec_2pt = Rectangle2Pt(Plane=PlaneXY(0, 0, 0), PointA=pt, PointB=pt_2, Radius=0)  # -> Rectangle, Length
boxrec = BoxRectangle(Rectangle=rec_2pt.Rectangle, Height=random_2)
geo = Geometry(boxrec)

# ----
panel = Panel("5,1,0")  # disabled
panel_2 = Panel("10,1,0")  # disabled
panel_3 = Panel("0,1,0")  # disabled
pt_3 = Point(panel_3)  # disabled
pt_4 = Point(panel)  # disabled
pt_5 = Point(panel_2)  # disabled
ln = Line(StartPoint=pt_3, EndPoint=pt_4)  # disabled
ln_2 = Line(StartPoint=pt_4, EndPoint=pt_5)  # disabled
panel_4 = Panel("-1")  # disabled
panel_5 = Panel("-1")  # disabled
merge = Merge(Data1=ln, Data2=ln_2)  # disabled
Z = UnitZ(Factor=panel_4)  # disabled
Z_2 = UnitZ(Factor=panel_5)  # disabled
panel_6 = Panel("0")  # disabled
panel_7 = Panel("1")  # disabled
supp = SupportKaramba3D(PosInd=pt_3, menu=[buttons(on, on, on, on, off, off)])  # disabled
supp_2 = SupportKaramba3D(PosInd=pt_5, menu=[buttons(off, on, on, off, off, off)])  # disabled
loads = LoadsKaramba3D(ForceVector=Z_2, Local=False, PosInd=pt_4, LCase=panel_7, mode="Point")  # disabled
beam_loads = BeamLoadsKaramba3D(LoadCase=panel_6, ForceVector=Z, TStart=0, TEnd=1, mode="Block", menu=[buttons(on, off, off)])  # disabled
linetobeam = LineToBeamKaramba3D(
    Line=merge,
    New=True,
    Remove=True,
    LimitDistance_m=0.005,
    Bending=True,
    SetBucklingLength=True,
    ToPolylineMaxAngle=0.03,
    ToPolylineTolerance=0.01,
    ToPolylineMinEdgeLength=0.25)  # -> Element, Points, Info; disabled
load = LoadKaramba(flatten([loads, beam_loads]))  # disabled
support = SupportKaramba([supp, supp_2])  # disabled
assemble = AssembleModelKaramba3D(Elem=linetobeam.Element, Support=support, Load=load, LimitDistance_m=0.005)  # -> Model, Info, Mass_kg, CenterOfGravity, LoadCaseNames; disabled
analyzethi = AnalyzeKaramba3D(Model=assemble.Model)  # -> CalculatedModel, MaximumDisplacement_cm, ResultingForceOfGravity_kN, ElasticEnergy_kNm; disabled
modelview = ModelViewKaramba3D(Model=analyzethi.CalculatedModel, ResultFactors=1, ResultCase=-1)  # -> Model, DeformedMesh, DeformedAxes, DeformedModel; disabled
beamview = BeamViewKaramba3D(Model=modelview.Model)  # -> Model, MeshesOfRenderedBeams, DeformedBeamAxes, LegendColors, LegendTags; disabled
utilization = UtilizationOfElementsKaramba3D(
    AnalyzedModel=beamview.Model,
    NumberOfSamplePoints=3,
    ElasticDesign=True,
    GammaM0=1,
    GammaM1=1.1,
    SwayFrame=True,
    WithDetails=False,
    mode="Beams")  # -> AnalyzedModel, Utilization, SigMax_kN_cm2, SigMin_kN_cm2, TauMax_kN_cm2, UtilN, UtilVy, UtilVz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; disabled
num = Number(utilization.Utilization)  # disabled
num_2 = Number([1.440260972, 1.440260972])  # disabled
similar = CSharpScript(x=num, y=num_2)  # -> out; inputs x: Double, y: Double; disabled
# ---------- similar: C# ----------
    if (Math.Abs(x - y) > 1E-10) throw new Exception ("The values x and y are not equal.");
# ---------- end similar ----------
panel_8 = Panel(num_2)  # disabled
panel_9 = Panel(num)  # disabled

crosecrselect = CrossSectionRangeSelectorKaramba(MaximumHeight_cm=-1, MaximumWidth_cm=-1, menu=[dropdown(1), dropdown(1), dropdown(1)])  # disabled
# Structural calcs
panel_10 = Panel("0,0,0")  # disabled
panel_11 = Panel("IPE300")  # disabled
Z_3 = UnitZ(Factor=1)  # disabled
pt_6 = Point(panel_10)  # disabled
panel_12 = Panel("3")  # disabled
crosecselect = CrossSectionSelectorKaramba(CrossSections=crosecrselect, NameOrListIndexOfCrossSection=panel_11)  # -> CrossSection, Info; disabled
line = LineSDL(Start=pt_6, Direction=Z_3, Length=panel_12)  # disabled
panel_13 = Panel("-500")  # disabled
Z_4 = UnitZ(Factor=panel_13)  # disabled
panel_14 = Panel("0")  # disabled
panel_15 = Panel("1")  # disabled
panel_16 = Panel("1")  # disabled
supp_3 = SupportKaramba3D(PosInd=panel_14, menu=[buttons(on, on, on, off, off, on)])  # disabled
supp_4 = SupportKaramba3D(PosInd=panel_16, menu=[buttons(on, on, off, off, off, off)])  # disabled
loads_2 = LoadsKaramba3D(ForceVector=Z_4, Local=False, PosInd=panel_15, LCase="0", mode="Point")  # disabled
linetobeam_2 = LineToBeamKaramba3D(
    Line=line,
    CrossSection=crosecselect.CrossSection,
    New=True,
    Remove=True,
    LimitDistance_m=0.005,
    Bending=True,
    SetBucklingLength=True,
    ToPolylineMaxAngle=0.03,
    ToPolylineTolerance=0.01,
    ToPolylineMinEdgeLength=0.25)  # -> Element, Points, Info; disabled
support_2 = SupportKaramba([supp_3, supp_4])  # disabled
assemble_2 = AssembleModelKaramba3D(Elem=linetobeam_2.Element, Support=support_2, Load=loads_2, LimitDistance_m=0.005)  # -> Model, Info, Mass_kg, CenterOfGravity, LoadCaseNames; disabled
analyzethii = AnalyzeThIIKaramba3D(Model=assemble_2.Model, RTolerance=1e-07, MaxIterations=50, NoTensionalNII=False)  # -> CalculatedModel, MaximumDisplacement_cm, ResultingForceOfGravity_kN, ElasticEnergy_kNm; disabled
modelview_2 = ModelViewKaramba3D(Model=analyzethii.CalculatedModel, ResultFactors=1, ResultCase=-1)  # -> Model, DeformedMesh, DeformedAxes, DeformedModel; disabled
toggle = BooleanToggle(True)  # disabled
panel_17 = Panel("1")  # disabled
utilization_2 = UtilizationOfElementsKaramba3D(
    AnalyzedModel=modelview_2.Model,
    NumberOfSamplePoints=3,
    ElasticDesign=True,
    GammaM0=1,
    GammaM1=panel_17,
    SwayFrame=True,
    WithDetails=toggle,
    mode="Beams")  # -> AnalyzedModel, Utilization, SigMax_kN_cm2, SigMin_kN_cm2, TauMax_kN_cm2, UtilN, UtilVy, UtilVz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; disabled
beamview_2 = BeamViewKaramba3D(Model=modelview_2.Model)  # -> Model, MeshesOfRenderedBeams, DeformedBeamAxes, LegendColors, LegendTags; disabled
panel_18 = Panel(utilization_2.Utilization)  # disabled
panel_19 = Panel(utilization_2.Details)  # disabled
legend = Legend(Colour=beamview_2.LegendColors, Tags=beamview_2.LegendTags, LegendType=1)  # disabled

# ----
# A tower with horizontal loads and variable diameter along its height is optimized for minimum deflection using Galapagos.
# create axis
# geometry
# convert axis
# to beams
# assemble
# analyze
# view
# supports
# loads
# define cross section
slider = Slider(14.2, range=5..15)  # disabled
slider_2 = Slider(13.2, range=5..15)  # disabled
slider_3 = Slider(5.8, range=5..15)  # disabled
slider_4 = Slider(12.2, range=5..15)  # disabled
slider_5 = Slider(14.8, range=5..15)  # disabled
slider_6 = Slider(11, range=5..15)  # disabled
slider_7 = Slider(11.7, range=5..15)  # disabled
range = Range(Domain=Domain(0, 6.283185307), Steps=16)  # disabled
range_2 = Range(Domain=Domain(0, 25), Steps=7)  # disabled
panel_20 = Panel("12")  # disabled
pt_7 = PointCylindrical(
    BasePlane=PlaneXY(0, 0, 0),
    Angle=graft(range),
    Radius=[panel_20, slider_2, slider_7, slider_6, slider, slider_5, slider_4, slider_3],
    Elevation=range_2)  # -> simplify(Point); disabled
galapagos = Galapagos()
item = ListItem(List=pt_7, Index=0, Wrap=True)  # -> flatten(Item); disabled
flip = FlipMatrix(Data=pt_7)  # disabled
series = Series(Start=0, Step=1, Count=8)  # disabled
shift = ShiftList(List=flip, Shift=expr("-x", graft(series)), Wrap=True)  # -> simplify(List); disabled
shift_2 = ShiftList(List=flip, Shift=graft(series), Wrap=True)  # -> simplify(List); disabled
cull_i = CullIndex(List=pt_7, Indices=0, Wrap=False)  # disabled
flip_2 = FlipMatrix(Data=cull_i)  # disabled
flip_3 = FlipMatrix(Data=shift_2)  # disabled
flip_4 = FlipMatrix(Data=shift)  # disabled
pline = PolyLine(Vertices=flip_2, Closed=False)  # disabled
pline_2 = PolyLine(Vertices=pt_7, Closed=False)  # disabled
pline_3 = PolyLine(Vertices=flip_3, Closed=False)  # disabled
pline_4 = PolyLine(Vertices=flip_4, Closed=False)  # disabled
slider_8 = Slider(16.1, range=0.1..30)  # disabled
slider_9 = Slider(0.2, range=0.1..3)  # disabled
rdpoints = RemoveDuplicatePointsKaramba(Point=item, LimitDistance=0.005)  # -> OutPoint, Info, Indexes; disabled
explode = Explode(Curve=[pline, pline_2, pline_3, pline_4], Recursive=True)  # -> flatten(Segments), Vertices; disabled
panel_21 = Panel("100,0,0")  # disabled
supp_5 = SupportKaramba3D(PosInd=rdpoints.OutPoint, menu=[buttons(on, on, on, off, off, off)])  # disabled
loads_3 = LoadsKaramba3D(ForceVector=panel_21, Local=False, PosInd=flatten(pt_7), LCase="0", mode="Point")  # disabled
cross_section = CrossSectionKaramba3D(
    FamilyNameOfCrossSection="DefaultCroSec",
    Material=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,
    Diameter_cm=slider_8,
    WallThickness_cm=slider_9,
    mode="Circular Hollow")  # disabled
linetobeam_3 = LineToBeamKaramba3D(
    Line=explode.Segments,
    New=True,
    Remove=True,
    LimitDistance_m=0.005,
    Bending=True,
    SetBucklingLength=True,
    ToPolylineMaxAngle=0.03,
    ToPolylineTolerance=0.01,
    ToPolylineMinEdgeLength=0.25)  # -> Element, Points, Info; disabled
assemble_3 = AssembleModelKaramba3D(Elem=linetobeam_3.Element, Support=supp_5, Load=loads_3, CrossSection=cross_section, LimitDistance_m=0.005)  # -> Model, Info, Mass_kg, CenterOfGravity, LoadCaseNames; disabled
analyzethi_2 = AnalyzeKaramba3D(Model=assemble_3.Model)  # -> CalculatedModel, MaximumDisplacement_cm, ResultingForceOfGravity_kN, ElasticEnergy_kNm; disabled
num_3 = Number(analyzethi_2.MaximumDisplacement_cm)  # disabled
modelview_3 = ModelViewKaramba3D(Model=analyzethi_2.CalculatedModel, ResultFactors=1, ResultCase=-1)  # -> Model, DeformedMesh, DeformedAxes, DeformedModel; disabled
beamview_3 = BeamViewKaramba3D(Model=modelview_3.Model)  # -> Model, MeshesOfRenderedBeams, DeformedBeamAxes, LegendColors, LegendTags; disabled

# ----
# Input structure
pipeline = GeometryPipeline(
    GroupByLayer=False,
    GroupByType=False,
    IncludeHidden=False,
    IncludeLocked=True,
    LayerFilter="*",
    NameFilter="*",
    SublayerFiltering=True,
    TypeFilter=1073741848)
geo_2 = Geometry(pipeline)
geo_3 = Geometry([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])

cluster_get_basic_geometry = ClusterGetBasicGeometry(geo=geo)  # -> section_area_2, profile_srf_2, center_line_2, profile_boundary_crv_2, geometry_bbox_2, centroid, box_volume
cluster_get_basic_geometry_2 = ClusterGetBasicGeometry(geo=geo_3)  # -> section_area_2, profile_srf_2, center_line_2, profile_boundary_crv_2, geometry_bbox_2, centroid, box_volume
geo_4 = Geometry(geo)

# ---- group: Format inputs
geo_5 = Geometry(geo_3)
area = Number(cluster_get_basic_geometry_2.section_area_2)
# Input preprocessing
line_2 = Line(cluster_get_basic_geometry_2.center_line_2)
len = Length(Curve=line_2)
line_length = Number(len)
area_2 = Number(area)
entwine = Entwine(Branch00=line_length, Branch01=area_2, Branch02=geo_5, Branch03=line_2, FlattenInputs=True)
flip_5 = FlipMatrix(Data=entwine)  # -> simplify(Data)

# ---- group: Distibute in circle
line_3 = Line(cluster_get_basic_geometry.center_line_2)
geo_6 = Geometry(geo_4)
pt_8 = Point(cluster_get_basic_geometry.centroid)
bbox = BoundingBox(Content=geo_3, Plane=PlaneXY(0, 0, 0), UnionBox=True)  # -> Box, Box_2
pl = PlaneNormal(Origin=pt_8, ZAxis=line_3)
boxprop = BoxProperties(Box=bbox.Box)  # -> Center, Diagonal, Area, Volume, Degeneracy
circle = CircleCNR(Center=boxprop.Center, Normal=Vector(0, 0, 1), Radius=12000)
orient = Orient(Geometry=line_3, Source=pl, Target=PlaneXY(0, 0, 0))  # -> Geometry, Transform
lng = ListLength(List=orient.Geometry)
divide = DivideCurve(Curve=circle, Count=lng, Kinks=False)  # -> Points, Tangents, Parameters
vec2pt = Vector2Pt(PointA=pt_8, PointB=divide.Points, Unitize=False)  # -> Vector, Length
move = Move(Geometry=geo_6, Motion=vec2pt.Vector)  # -> Geometry, Transform
move_2 = Move(Geometry=line_3, Motion=vec2pt.Vector)  # -> Geometry, Transform
geo_7 = Geometry(move.Geometry)
line_4 = Line(move_2.Geometry)

# ---- group: Distibute in line
pt_9 = Point(cluster_get_basic_geometry.centroid)  # disabled
line_5 = Line(cluster_get_basic_geometry.center_line_2)  # disabled
geo_8 = Geometry(geo_4)  # disabled
pl_2 = PlaneNormal(Origin=pt_9, ZAxis=line_5)  # disabled
orient_2 = Orient(Geometry=line_5, Source=pl_2, Target=PlaneXY(0, 0, 0))  # -> Geometry, Transform; disabled
lng_2 = ListLength(List=orient_2.Geometry)  # disabled
series_2 = Series(Start=0, Step=500, Count=lng_2)  # disabled
Y = UnitY(Factor=series_2)  # disabled
move_3 = Move(Geometry=geo_8, Motion=Y)  # -> Geometry, Transform; disabled
move_4 = Move(Geometry=line_5, Motion=Y)  # -> Geometry, Transform; disabled

# ---- group: Format inputs
line_6 = Line(line_4)
geo_9 = Geometry(geo_7)
area_3 = Number(cluster_get_basic_geometry.section_area_2)
len_2 = Length(Curve=line_6)
line_length_2 = Number(len_2)
area_4 = Number(area_3)
entwine_2 = Entwine(Branch00=line_length_2, Branch01=area_4, Branch02=geo_9, Branch03=line_6, FlattenInputs=True)
flip_6 = FlipMatrix(Data=entwine_2)  # -> simplify(Data)

# ---- group: Core of the script
# Mapping
demand_tree = Data(flip_5)
supply_tree = Data(flip_6)
python = GhPythonScript(demand=demand_tree, supply=supply_tree)  # -> out, mapping_id, cut_length, temp; inputs demand: tree, supply: tree
# ---------- python: Python ----------
"""Provides a scripting component.
    Inputs:
        demand: testsetste
        y: The y script variable
    Output:
        a: The a output variable"""

__author__ = "arturbt"
__version__ = "2022.07.26"

import rhinoscriptsyntax as rs
import ghpythonlib.treehelpers as th
import Rhino

""" METHODS """ 

def tree2lol(input_tree):
    # https://developer.rhino3d.com/guides/rhinopython/grasshopper-datatrees-and-python/    lol = []
    lol=[]
    for i in range(input_tree.BranchCount):
        sublist = []
        branchPath = input_tree.Path(i)
        branchList = input_tree.Branch(i)
        for j in range(branchList.Count):
            sublist.append(branchList[j])
        lol.append(sublist)
    return lol

def lol2tree(input_lol):
    # https://developer.rhino3d.com/guides/rhinopython/grasshopper-datatrees-and-python/
    tree = th.list_to_tree(input_lol, source=[0,0])
    return tree

""" INPUT """ 

# turn to list of lists and sort by length
demand_list = sorted(tree2lol(demand), key=lambda x: x[0]) 
supply_list = sorted(tree2lol(supply), key=lambda x: x[0])

# add original index (branch path) because later we delete  some
[demand_list[i].append(i) for i in range(len(demand_list))]
[supply_list[i].append(i) for i in range(len(supply_list))]


""" CALCULATION """ 

mapping_id = []
cut_length = []
temp = []

for i in range(len(demand_list)):
    match=False
    for j in range(len(supply_list)):
        if demand_list[i][0] <= supply_list[j][0] and demand_list[i][1] <= supply_list[j][1]:
            match=True
            mapping_id.append(supply_list[j][-1])
            cut_length.append(supply_list[j][0] - demand_list[i][0])
            temp.append(supply_list[j])
            break
    if match:
        del supply_list[j]
    else:
        mapping_id.append(None)
        cut_length.append(None)

""" OUTPUT """

mapping_id = lol2tree(mapping_id)
temp = lol2tree(temp)
# ---------- end python ----------

# ---- group: Get matched elements
demand_tree_2 = Data(demand_tree)
num_4 = Number(python.mapping_id)
tstat = TreeStatistics(Tree=demand_tree_2)  # -> Paths, Length, Count
series_3 = Series(Start=0, Step=1, Count=tstat.Count)
null = NullItem(Item=num_4)  # -> NullFlags, InvalidFlags, Description
dispatch = Dispatch(List=num_4, DispatchPattern=null.NullFlags)  # -> ListA, ListB
dispatch_2 = Dispatch(List=series_3, DispatchPattern=null.NullFlags)  # -> ListA, ListB
path = ConstructPath(Indices=graft(dispatch_2.ListA))  # -> flatten(Branch)
path_2 = ConstructPath(Indices=graft(dispatch.ListB))  # -> flatten(Branch)
path_3 = ConstructPath(Indices=graft(dispatch_2.ListB))  # -> flatten(Branch)
branch = TreeBranch(Tree=demand_tree_2, Path=path, MaintainPaths=True)
branch_2 = TreeBranch(Tree=supply_tree, Path=path_2, MaintainPaths=True)
branch_3 = TreeBranch(Tree=demand_tree_2, Path=path_3, MaintainPaths=True)
unmatched_demand = Data(branch)
matched_demand = Data(branch_3)
matching_supply = Data(branch_2)

# ---- group: Calculate cut length
num_5 = Number(python.cut_length)
null_2 = NullItem(Item=num_5)  # -> NullFlags, InvalidFlags, Description
dispatch_3 = Dispatch(List=num_5, DispatchPattern=null_2.NullFlags)  # -> ListA, ListB
ma = MassAddition(Input=dispatch_3.ListB)  # -> Result, PartialResults
division = Division(A=ma.Result, B=1000)
total_cut_length_m = Panel(division)

# ---- group: Display results
item_2 = ListItem(List=unmatched_demand, Index="2", Wrap=True)
item_3 = ListItem(List=matched_demand, Index="3", Wrap=True)
item_4 = ListItem(List=matched_demand, Index="2", Wrap=True)
item_5 = ListItem(List=matching_supply, Index="3", Wrap=True)
item_6 = ListItem(List=matching_supply, Index="2", Wrap=True)
curvepoint = PointOnCurve(item_3, parameter=0.5)
curvepoint_2 = PointOnCurve(item_5, parameter=0.5)
ln_3 = Line(StartPoint=curvepoint, EndPoint=curvepoint_2)
preview = CustomPreview(Geometry=ln_3, Material=ColourSwatch(SwatchColor=RGB(230, 182, 101)))
preview_2 = CustomPreview(Geometry=item_6, Material=ColourSwatch(SwatchColor=RGB(101, 200, 230)))
preview_3 = CustomPreview(Geometry=item_4, Material=ColourSwatch(SwatchColor=RGB(80, 166, 46)))
preview_4 = CustomPreview(Geometry=item_2, Material=ColourSwatch(SwatchColor=RGB(168, 32, 32)))

# ==== cluster ClusterGetBasicGeometry
geo = ClusterInput()

# ---- group: Take longest edge
geo_2 = Geometry(geo)
debrep = DeconstructBrep(Brep=geo_2)  # -> Faces, Edges, Vertices
len = Length(Curve=debrep.Edges)
lng = ListLength(List=len)
series = Series(Start=0, Step=1, Count=lng)
sort = SortList(Keys=len, ValuesA=series)  # -> Keys, ValuesA
item = ListItem(List=sort.ValuesA, Index=-1, Wrap=True)
item_2 = ListItem(List=debrep.Edges, Index=item, Wrap=True)
line = Line(flatten(item_2))
geo_3 = Geometry(geo_2)

# ---- group: Get profile and bbox
line_2 = Line(line)
geo_4 = Geometry(geo_3)
curvepoint = PointOnCurve(line_2, parameter=0.5)
vec = Vector(line_2)
pl = PlaneNormal(Origin=curvepoint, ZAxis=vec)
mesh = Mesh(geo_4)
bbox = BoundingBox(Content=graft(geo_4), Plane=graft(pl), UnionBox=False)  # -> flatten(Box), flatten(Box_2)
sec = MeshPlane(Mesh=mesh, Plane=pl)
boundary = BoundarySurfaces(Edges=sec)
profile_boundary_crv = Curve(flatten(sec))
geometry_bbox = Box(bbox.Box)
profile_srf = Surface(flatten(boundary))

# ----
boxprop = BoxProperties(Box=geometry_bbox)  # -> Centroid, Diagonal, Area, BoxVolume, Degeneracy

# ---- group: Take longest edge
geo_5 = Geometry(geometry_bbox)
debrep_2 = DeconstructBrep(Brep=geo_5)  # -> Faces, Edges, Vertices
len_2 = Length(Curve=debrep_2.Edges)
lng_2 = ListLength(List=len_2)
series_2 = Series(Start=0, Step=1, Count=lng_2)
sort_2 = SortList(Keys=len_2, ValuesA=series_2)  # -> Keys, ValuesA
item_3 = ListItem(List=sort_2.ValuesA, Index=-1, Wrap=True)
item_4 = ListItem(List=debrep_2.Edges, Index=item_3, Wrap=True)
line_3 = Line(flatten(item_4))

# ----
profile_srf_2 = ClusterOutput(profile_srf)
profile_boundary_crv_2 = ClusterOutput(profile_boundary_crv)
geometry_bbox_2 = ClusterOutput(geometry_bbox)
centroid = ClusterOutput(boxprop.Centroid)
box_volume = ClusterOutput(boxprop.BoxVolume)

# ---- group: Locate centerline and get area
profile_srf_3 = Surface(profile_srf)
line_4 = Line(line_3)
area = Area(Geometry=profile_srf_3)  # -> Area, Centroid
crv_cp = CurveClosestPoint(Point=area.Centroid, Curve=line_4)  # -> Point, Parameter, Distance
vec2pt = Vector2Pt(PointA=crv_cp.Point, PointB=area.Centroid, Unitize=False)  # -> Vector, Length
move = Move(Geometry=line_4, Motion=vec2pt.Vector)  # -> Geometry, Transform
center_line = Line(move.Geometry)
section_area = Number(area.Area)

# ----
section_area_2 = ClusterOutput(section_area)
center_line_2 = ClusterOutput(center_line)
